# Grasshopper definition Tether_v0.5.gh (Grasshopper 1.0.7)
# plug-ins: Heteroptera, Geospatial, Human UI, Pufferfish, Human, EleFront, gHowl, LunchBox

udp_receiver = UDPReceiver(Address="127.0.0.1", Port="12000", Pattern="999")  # -> Info, Data
list_item = ListItem(List=udp_receiver.Data, Index="1", Wrap=True)  # -> flatten(Item)
panel = Panel(list_item)

timer = Timer(TimerInterval=500, Target=[dynamic_geometry_pipeline, dynamic_geometry_pipeline_2])

# ----
# EXPORT
layer_information = LayerInformation(ReferenceToggle=True)  # -> flatten(Names), DisplayColors, GUID
null_item = NullItem(Item=layer_information.Names)  # -> NullFlags, InvalidFlags, Description
create_label = CreateLabel(LabelText="Choose Layer to export", LabelSize=12, Justification=0)
create_button = CreateButton(ButtonName="Export to CSV", ButtonStyle=3)
cull_pattern = CullPattern(List=layer_information.Names, CullPattern=invert(null_item.NullFlags))
panel_2 = Panel(cull_pattern)
create_list_box = CreateListBox(ListItems=cull_pattern, SelectedIndex=0, Height=100)
value_listener = ValueListener(Elements=create_list_box, NameFilterS="List Box 1", SomeProperty=True)  # -> Values, Indices
merge = Merge(Data1=create_label, Data2=create_list_box, Data3=create_button)
panel_3 = Panel(value_listener.Values)
reference_by_layer = ReferenceByLayer(LayerName=value_listener.Values)
value_listener_2 = ValueListener(Elements=create_button, NameFilterS="Export to CSV", SomeProperty=True)  # -> Values, Indices
panel_4 = Panel(reference_by_layer)
panel_5 = Panel(value_listener_2.Values)
object_attributes = ObjectAttributes(ObjectOrAttributes=reference_by_layer)  # -> Name, LayerName, LayerFullPath, Color, MaterialName, LinetypeName, GroupIndices, PlotWeight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
panel_6 = Panel(object_attributes.UserDataValues)
deconstruct = Deconstruct(Point=reference_by_layer)  # -> XComponent, YComponent, ZComponent
list_item_2 = ListItem(List=object_attributes.UserDataValues, Index="1", Wrap=True)  # -> flatten(Item)
list_item_3 = ListItem(List=object_attributes.UserDataValues, Index=0, Wrap=True)  # -> flatten(Item)
panel_7 = Panel("""layer
participant
x
y
z
timestamp
type""")
entwine = Entwine(
    Branch0X=object_attributes.LayerName,
    Branch1X=object_attributes.Name,
    Branch2X=deconstruct.XComponent,
    Branch3X=deconstruct.YComponent,
    Branch4X=deconstruct.ZComponent,
    Branch5X=list_item_3,
    Branch6X=list_item_2,
    FlattenInputs=False)
panel_8 = Panel(list_item_3)
create_csv = CreateCSV(DataGridHeaders=panel_7, ValueTree=entwine, Delimiter=",")
panel_9 = Panel(create_csv)
timer_2 = Timer(TimerInterval=1000, Target=time)
file_path = FilePath("C:\Users\Cognition\Desktop\")
time = Time("Now")
deconstruct_date = DeconstructDate(Date=time)  # -> Year, Month, Day, Hour, Minute, Second
concatenate = Concatenate(
    Fragment_A=deconstruct_date.Year,
    Fragment_B=deconstruct_date.Month,
    A=deconstruct_date.Day,
    B="_",
    C=deconstruct_date.Hour,
    D=deconstruct_date.Minute,
    E=deconstruct_date.Second)
concatenate_2 = Concatenate(Fragment_A=value_listener.Values, B="_timestampted_trajectories-", Fragment_B=concatenate, A=".csv")
panel_10 = Panel(concatenate_2)
write_file = WriteFile(Directory=file_path, Filename=concatenate_2, Data=create_csv, Run=value_listener_2.Values)

# ----
# MAIN UI
panel_11 = Panel("Point count: ")
panel_12 = Panel("""trajectory
pause
map
looking_around
asking directions""")
create_text_box = CreateTextBox(Label="Participant", DefaultText="enter participant id", UpdateButton=True, showLabel=True)
create_label_2 = CreateLabel(LabelText="Trajectory ", LabelSize=18, Justification=0)
create_label_3 = CreateLabel(LabelText="Length: ", LabelSize=12, Justification=0)
create_label_4 = CreateLabel(LabelText=panel_11, LabelSize=12, Justification=0)
behaviour_types = CreateListBox(ListItems=panel_12, SelectedIndex=0, Height=150)
create_label_5 = CreateLabel(LabelText="Set Behaviour Type", LabelSize=18, Justification=0)
my_slidererb = CreateSlider(
    Slider=Slider(3, range=0..100),
    SnapValue=1,
    ShowBounds=True,
    ShowTicks=True,
    ShowTooltip=True,
    ShowValLabel=True,
    showLabel=True)
create_button_2 = CreateButton(ButtonName="backwards 5 seconds", ButtonStyle=1)
create_button_3 = CreateButton(ButtonName="forwards 5 seconds", ButtonStyle=1)
create_label_6 = CreateLabel(LabelText="timestamp", LabelSize=12, Justification=0)
create_label_7 = CreateLabel(LabelText="current layer:", LabelSize=12, Justification=0)
create_toggle = CreateToggle(Default=True, Label="show point info")
c_script = CSharpScript()  # -> out, CurrentLayer
# ---------- c_script: C# ----------
    CurrentLayer = RhinoDocument.Layers.CurrentLayer;
# ---------- end c_script ----------
merge_2 = Merge(
    Data1=create_label_6,
    Data2=create_label_7,
    Data3=create_text_box,
    Data4=create_toggle,
    Data5=create_label_5,
    Data6=behaviour_types,
    Data7=create_label_2,
    Data8=create_label_4,
    Data9=create_label_3,
    Data10=my_slidererb,
    Data11=create_button_2,
    Data12=create_button_3)
panel_13 = Panel("""input
export""")
launch_window = LaunchWindow(Show=Toggle(True), Name="Timestamp Trajectories", Width=370, Height=500, ChildStatus=2, EnableHorizScroll=False)
tabbed_view = TabbedView(TabNames=panel_13, Tab0=flatten(merge_2), Tab1=flatten(merge))
add_elements = AddElements(Window=launch_window, Elements=flatten(tabbed_view), DoVLChecking=False)  # -> AddedElements, ElementNames
window_status = WindowStatus(Window=launch_window)
value_listener_3 = ValueListener(Elements=behaviour_types, NameFilterS="List Box", SomeProperty=True)  # -> Values, Indices
panel_14 = Panel("- 5")
panel_15 = Panel("+ 5")
panel_16 = Panel(value_listener_3.Values)
value_listener_4 = ValueListener(Elements=create_text_box, NameFilterS="TextBox: Participant", SomeProperty=True)  # -> Values, Indices
value_listener_5 = ValueListener(Elements=create_button_2, NameFilterS="backwards 5 seconds", SomeProperty=True)  # -> Values, Indices
value_listener_6 = ValueListener(Elements=my_slidererb, NameFilterS="Number Slider", SomeProperty=True)  # -> Values, Indices
value_listener_7 = ValueListener(Elements=create_button_3, NameFilterS="forwards 5 seconds", SomeProperty=True)  # -> Values, Indices
panel_17 = Panel(value_listener_5.Values)
panel_18 = Panel(value_listener_7.Values)

timer_3 = Timer(TimerInterval=1000, Target=c_script)
concatenate_3 = Concatenate(FragmentA="current layer:", FragmentB=c_script.CurrentLayer, JoinSeparator=" ")
panel_19 = Panel(udp_receiver.Data)
data_dam = DataDam(DataDataA=list_item, BufferDelay=10000000, BufferMode=2)
division = Division(A=data_dam, B=100000)
division_2 = Division(A=list_item, B=1000)
round = Round(Number=division)  # -> Nearest, Floor, Ceiling
set_label_contents = SetLabelContents(LabelToModify=create_label_7, NewLabelContents=concatenate_3)
value_listener_8 = ValueListener(Elements=create_toggle, SomeProperty=True)  # -> Values, Indices
concatenate_4 = Concatenate(FragmentA="timestamp: ", FragmentB=round.Nearest)
set_label_contents_2 = SetLabelContents(LabelToModify=create_label_6, NewLabelContents=concatenate_4)

# ----
# ADD ATTRIBUTES TO NEW POINT
panel_20 = Panel("tether")
dynamic_geometry_pipeline = DynamicGeometryPipeline(
    LayerFilter=panel_20,
    TypeFilter="Point",
    GroupByLayer=False,
    GroupByType=False,
    IncludeHidden=True,
    IncludeLocked=True,
    enableFullPath=False,
    listenToAttributes=True)
merge_3 = Merge(Data1=division_2, Data2=value_listener_3.Values)  # -> flatten(Result)
point = Point(dynamic_geometry_pipeline)
panel_21 = Panel("""frame
behaviour_type""")
createattributes = CreateAttributes(
    Name=value_listener_4.Values,
    LayerName=panel_20,
    UserDataKeys=flatten(panel_21),
    UserDataValues=merge_3,
    enableFullPath=False)
modify_object_attributes = ModifyObjectAttributes(Objects=point, Attributes=createattributes)

# ----
# CONTROL PLAYBACK (PROCESSING)
panel_22 = Panel("32000")
number = Number(value_listener_6.Values)
number_2 = Number(value_listener_5.Values)
number_3 = Number(value_listener_7.Values)
multiplication = Multiplication(A=number_2, B="-5")
multiplication_2 = Multiplication(A=number_3, B=5)
panel_23 = Panel("/GH/none/")
panel_24 = Panel(["/control/slider", number])
panel_25 = Panel(["/control/time", multiplication_2])
panel_26 = Panel(multiplication_2)
panel_27 = Panel(["/control/time", multiplication])
stream_freeze_gate = StreamFreezeGate(Data=panel_25, PassingSwitch=number_3)
stream_freeze_gate_2 = StreamFreezeGate(Data=panel_27, PassingSwitch=number_2)
udp_sender = UDPSender(Address="127.0.0.1", Port=panel_22, Pattern="999", Data=panel_24)
udp_sender_2 = UDPSender(Address="127.0.0.1", Port=panel_22, Pattern="999", Data=stream_freeze_gate)
udp_sender_3 = UDPSender(Address="127.0.0.1", Port=panel_22, Pattern="999", Data=stream_freeze_gate_2)

# ---- group: Draws existing points
# VISUALISE POLYLINE
panel_28 = Panel(value_listener_4.Values)
panel_29 = Panel("input")
dynamic_geometry_pipeline_2 = DynamicGeometryPipeline(
    LayerFilter=panel_20,
    TypeFilter="Point",
    NameFilter=panel_28,
    GroupByLayer=False,
    GroupByType=False,
    IncludeHidden=True,
    IncludeLocked=True,
    enableFullPath=False,
    listenToAttributes=True)
point_2 = Point(dynamic_geometry_pipeline_2)
object_attributes_2 = ObjectAttributes(ObjectOrAttributes=point_2)  # -> Name, LayerName, LayerFullPath, Color, MaterialName, LinetypeName, GroupIndices, PlotWeight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
list_item_4 = ListItem(List=object_attributes_2.UserDataValues, Index=1, Wrap=True)
list_item_5 = ListItem(List=object_attributes_2.UserDataValues, Index=0, Wrap=True)
match_text = MatchText(Text=list_item_4, Pattern="trajectory", Case=True)
panel_30 = Panel(list_item_5)
sort_list = SortList(Keys=flatten(list_item_5), ValuesValuesA=point_2)  # -> Keys, ValuesValuesA
unit_x = UnitX(Factor=1)
cull_pattern_2 = CullPattern(List=point_2, CullPattern=flatten(match_text))
expression = Expression(x=flatten(object_attributes_2.Name), y=flatten(sort_list.Keys), Expression="\"P\"& x & \" T\" & y")
move = Move(Geometry=sort_list.ValuesValuesA, Motion=unit_x)  # -> Geometry, Transform
polyline = PolyLine(Vertices=sort_list.ValuesValuesA, Closed=False)
panel_31 = Panel(expression)
list_length = ListLength(List=cull_pattern_2)
length = Length(Curve=polyline)
round_to_decimal_place = RoundToDecimalPlace(NumberX=length, DecimalPlace=1, RoundType=0)  # -> Rounded, Difference
list_item_6 = ListItem(List=udp_receiver.Data, Index="2", Wrap=True)  # -> flatten(Item)
custom_preview_lineweights = CustomPreviewLineweights(
    Geometry=polyline,
    Shader={diffuse=RGB(255, 105, 180), emission=RGB(76, 32, 54), shine=0.5, specular=RGB(255, 255, 255), transparency=0},
    Thickness=Slider(2, range=0..10),
    Absolute=False)
panel_32 = Panel("""0
100""")
concatenate_5 = Concatenate(FragmentA="Length: ", FragmentB=round_to_decimal_place.Rounded)
concatenate_6 = Concatenate(FragmentA=panel_11, FragmentB=list_length)

# ----
stream_gate = StreamGate(Stream=expression, Gate=value_listener_8.Values)  # -> Target0, Target1

# ---- group: Draws existing points (continued)
text_tag = TextTag(Location=move.Geometry, Text=stream_gate.Target1, Colour=ColourSwatch(SwatchColor=RGB(255, 255, 255)))

# ---- group: Draws existing points / Update interface
set_label_contents_3 = SetLabelContents(LabelToModify=create_label_4, NewLabelContents=concatenate_6)
set_label_contents_4 = SetLabelContents(LabelToModify=create_label_3, NewLabelContents=concatenate_5)
set_slider = SetSlider(UISlider=my_slidererb, Value=list_item_6, Range=panel_32)
