# Grasshopper definition Tether_v0.7.gh (Grasshopper 1.0.8)
# plug-ins: RhinoCodePluginGH, Heteroptera, Human UI, Human, gHowl, LunchBox

panel = Panel("""trajectory
pause
map
looking_around
asking directions""")

# ---- group: Timer settings
# RECEIVE OSC
timer = Timer(Interval=500, TimerInterval=500)

# ----
# MAIN UI
panel_2 = Panel("timestamp")
timeline = Slider(3, range=0..100)
udp_receiver = UDPReceiver(Address="127.0.0.1", Port="12000", Pattern="999")  # -> Info, Data
create_label = CreateLabel(LabelText="Length: ", LabelSize=12, Justification=0)
create_label_2 = CreateLabel(LabelText="Point count: ", LabelSize=12, Justification=0)
create_text_box = CreateTextBox(Label="Participant", DefaultText="enter participant id", UpdateButton=False, showLabel=True)
behaviour_types = CreateListBox(ListItems=panel, SelectedIndex=0, Height=150)
my_slidererb = CreateSlider(Slider=timeline, SnapValue=1, ShowBounds=True, ShowTicks=True, ShowTooltip=True, ShowValLabel=True, showLabel=True)
create_label_3 = CreateLabel(LabelText="Set Point Type", LabelSize=18, Justification=0)
create_label_4 = CreateLabel(LabelText="Trajectory ", LabelSize=18, Justification=0)
create_button = CreateButton(ButtonName="backwards", ButtonStyle=1)
create_button_2 = CreateButton(ButtonName="play | pause", ButtonStyle=1)
create_button_3 = CreateButton(ButtonName="forward", ButtonStyle=1)
create_label_5 = CreateLabel(LabelText=panel_2, LabelSize=12, Justification=0)
create_label_6 = CreateLabel(LabelText="current layer:", LabelSize=12, Justification=0)
create_toggle = CreateToggle(Default=True, Label="show point info")
panel_3 = Panel(udp_receiver.Data)
panel_4 = Panel(udp_receiver.Info)
merge = Merge(Data1=create_button, Data2=create_button_2, Data3=create_button_3)
timer_2 = Timer(Interval=1000, TimerInterval=1000, Target=c_script)
c_script = CSharpScript()  # -> out, CurrentLayer
# ---------- c_script: C# ----------
    CurrentLayer = RhinoDocument.Layers.CurrentLayer;
# ---------- end c_script ----------
list_item = ListItem(List=udp_receiver.Data, Index="1", Wrap=True)  # -> flatten(Item)
concatenate = Concatenate(FragmentA="current layer:", FragmentB=c_script.CurrentLayer, JoinSeparator=" ")
data_dam = DataDam(DataDataA=list_item, BufferDelay=2500000, BufferMode=2)  # disabled
panel_5 = Panel(list_item)
set_label_contents = SetLabelContents(LabelToModify=create_label_6, NewLabelContents=concatenate)
round_c = CSharpScript(data=list_item, decimals="2")  # -> out, a; inputs data: Double, decimals: Int32
# ---------- round_c: C# ----------
// Grasshopper Script Instance
#region Usings
using System;
using System.Linq;
using System.Collections;
using System.Collections.Generic;
using System.Drawing;

using Rhino;
using Rhino.Geometry;

using Grasshopper;
using Grasshopper.Kernel;
using Grasshopper.Kernel.Data;
using Grasshopper.Kernel.Types;
#endregion

public class Script_Instance : GH_ScriptInstance
{
    #region Notes
    /* 
      Members:
        RhinoDoc RhinoDocument
        GH_Document GrasshopperDocument
        IGH_Component Component
        int Iteration

      Methods (Virtual & overridable):
        Print(string text)
        Print(string format, params object[] args)
        Reflect(object obj)
        Reflect(object obj, string method_name)
    */
    #endregion

    private void RunScript(double data, int decimals, ref object a)
    {
        // Write your logic here
        a = Math.Round(data, decimals);
        //a = null;

    }
}
# ---------- end round_c ----------
concatenate_2 = Concatenate(FragmentA="timestamp: ", FragmentB=round_c.a)
set_label_contents_2 = SetLabelContents(LabelToModify=create_label_5, NewLabelContents=concatenate_2)
panel_6 = Panel("+ 5")

panel_7 = Panel("""1*
1*
1*""")
panel_8 = Panel("""1*
1*
1*""")
panel_9 = Panel("""0
0
0""")
panel_10 = Panel("""0
1
2""")
create_grid = CreateGrid(
    UIElements=merge,
    Width="370",
    RowDefinitions=panel_7,
    ColumnDefinitions=panel_8,
    ElementRow=panel_9,
    ElementColumn=panel_10,
    ElementRowSpan=1,
    ElementColumnSpan=370)

panel_11 = Panel("- 5")
panel_12 = Panel("play ")
value_listener = ValueListener(Elements=create_button_3, SomeProperty=True)  # -> Values, Indices
value_listener_2 = ValueListener(Elements=create_button_2, SomeProperty=True)  # -> Values, Indices
value_listener_3 = ValueListener(Elements=create_button, SomeProperty=True)  # -> Values, Indices
value_listener_4 = ValueListener(Elements=my_slidererb, SomeProperty=True)  # -> Values, Indices
panel_13 = Panel(value_listener_3.Values)
panel_14 = Panel(value_listener.Values)
panel_15 = Panel(value_listener_2.Values)
merge_2 = Merge(
    Data1=create_label_5,
    Data2=create_label_6,
    Data3=create_text_box,
    Data4=create_toggle,
    Data5=create_label_3,
    Data6=behaviour_types,
    Data7=create_label_4,
    Data8=create_label_2,
    Data9=create_label,
    Data10=my_slidererb,
    Data13=create_grid)
# CONTROL PLAYBACK (PROCESSING)
panel_16 = Panel("32000")

# ---- group: backward
number = Number(value_listener_3.Values)
multiplication = Multiplication(A=number, B="-5")
panel_17 = Panel(["/control/time", multiplication])
stream_freeze_gate = StreamFreezeGate(Data=panel_17, PassingSwitch=number)
udp_sender = UDPSender(Address="127.0.0.1", Port=panel_16, Pattern="999", Data=stream_freeze_gate)

# ---- group: forward
number_2 = Number(value_listener.Values)
multiplication_2 = Multiplication(A=number_2, B="5")
panel_18 = Panel(["/control/time", multiplication_2])
stream_freeze_gate_2 = StreamFreezeGate(Data=panel_18, PassingSwitch=number_2)
udp_sender_2 = UDPSender(Address="127.0.0.1", Port=panel_16, Pattern="999", Data=stream_freeze_gate_2)

# ---- group: play
number_3 = Number(value_listener_2.Values)
panel_19 = Panel(["/control/play", number_3])
stream_freeze_gate_3 = StreamFreezeGate(Data=panel_19, PassingSwitch=number_3)
udp_sender_3 = UDPSender(Address="127.0.0.1", Port=panel_16, Pattern="999", Data=stream_freeze_gate_3)

# ---- group: slider
number_4 = Number(value_listener_4.Values)
panel_20 = Panel(["/control/slider", number_4])
udp_sender_4 = UDPSender(Address="127.0.0.1", Port=panel_16, Pattern="999", Data=panel_20)

# ----
py3 = Python3Script()  # -> out, a; unedited script template
panel_21 = Panel("not downloading")
panel_22 = Panel(udp_sender)
launch_window = LaunchWindow(Show=Toggle(True), Name="Tether v0.6", Width=370, Height=500, ChildStatus=2, EnableHorizScroll=False)
panel_26 = Panel("""input
export""")
timer_3 = Timer(Interval=1000, TimerInterval=1000, Target=layer_information)
layer_information = LayerInformation(ReferenceToggle=True)  # -> flatten(Names), DisplayColors, GUID
# EXPORT
panel_27 = Panel("Choose Layer to export")
null_item = NullItem(Item=layer_information.Names)  # -> NullFlags, InvalidFlags, Description
create_file_picker = CreateFilePicker(ButtonLabelText="Select folder", DialogType=2, MustExist=True, Filter="All Files|*.*")
create_list_box = CreateListBox(ListItems="Default", SelectedIndex=0, Height=100)
create_button_4 = CreateButton(ButtonName="Export to CSV", ButtonStyle=3)
create_label_7 = CreateLabel(LabelText=panel_27, LabelSize=12, Justification=0)
cull_pattern = CullPattern(List=layer_information.Names, CullPattern=invert(null_item.NullFlags))
panel_28 = Panel(cull_pattern)
value_listener_5 = ValueListener(Elements=create_list_box, NameFilterS="List Box 1", SomeProperty=True)  # -> Values, Indices
value_listener_6 = ValueListener(Elements=create_button_4, NameFilterS="Export to CSV", SomeProperty=True)  # -> Values, Indices
merge_3 = Merge(Data1=create_label_7, Data2=create_list_box, Data3=create_file_picker, Data4=create_button_4)
set_list_contents = SetListContents(ListToModify=create_list_box, NewListContents=cull_pattern)
panel_29 = Panel(value_listener_6.Values)
dynamic_geometry_pipeline = DynamicGeometryPipeline(
    LayerFilter=value_listener_5.Values,
    TypeFilter="Point",
    NameFilter="*",
    GroupByLayer=False,
    GroupByType=False,
    IncludeHidden=True,
    IncludeLocked=True,
    enableFullPath=False,
    listenToAttributes=True)
panel_30 = Panel(value_listener_5.Values)
object_attributes = ObjectAttributes(ObjectOrAttributes=dynamic_geometry_pipeline)  # -> Name, LayerName, LayerFullPath, Color, MaterialName, LinetypeName, GroupIndices, PlotWeight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
panel_31 = Panel("1")
deconstruct = Deconstruct(Point=dynamic_geometry_pipeline)  # -> XComponent, YComponent, ZComponent
list_item_2 = ListItem(List=object_attributes.UserDataValues, Index=0, Wrap=True)  # -> flatten(Item)
list_item_3 = ListItem(List=object_attributes.UserDataValues, Index=1, Wrap=True)  # -> flatten(Item)
list_item_4 = ListItem(List=object_attributes.UserDataValues, Index=2, Wrap=True)  # -> flatten(Item)
entwine = Entwine(
    Branch00=flatten(object_attributes.LayerName),
    Branch01=list_item_2,
    Branch02=deconstruct.XComponent,
    Branch03=deconstruct.YComponent,
    Branch04=deconstruct.ZComponent,
    Branch05=list_item_4,
    Branch06=list_item_3,
    FlattenInputs=True)
panel_32 = Panel("""layer
participant
x
y
z
timestamp
annotation_type""")
create_csv = CreateCSV(header=panel_32, data=entwine, sep=",")
panel_33 = Panel(entwine)
create_csv_2 = CreateCSV(DataGridHeaders=panel_32, ValueTree=entwine, Delimiter=",")
timer_4 = Timer(Interval=1000, TimerInterval=1000, Target=time)
panel_34 = Panel(create_csv)
time = Time("Now")
value_listener_7 = ValueListener(Elements=create_file_picker, NameFilterS="Select folder", SomeProperty=True)  # -> Values, Indices
deconstruct_date = DeconstructDate(Date=time)  # -> Year, Month, Day, Hour, Minute, Second
concatenate_3 = Concatenate(
    Fragment_A=deconstruct_date.Year,
    Fragment_B=deconstruct_date.Month,
    A=deconstruct_date.Day,
    B="_",
    C=deconstruct_date.Hour,
    D=deconstruct_date.Minute,
    E=deconstruct_date.Second)
concatenate_4 = Concatenate(Fragment_A=value_listener_5.Values, B="_timestampted_coordinates-", Fragment_B=concatenate_3, A=".csv")
file_path = FilePath(value_listener_7.Values)
panel_35 = Panel(concatenate_4)
tabbed_view = TabbedView(TabNames=panel_26, Tab0=flatten(merge_2), Tab1=flatten(merge_3))
concat = Concatenate(FragmentA=file_path, FragmentB=panel_35, JoinSeparator="/")
panel_36 = Panel(concat)
button = Button()
add_elements = AddElements(Window=launch_window, Elements=flatten(tabbed_view), DoVLChecking=False)  # -> AddedElements, ElementNames
c_script_2 = CSharpScript(save=value_listener_6.Values, path=panel_36, data=create_csv)  # inputs save: Boolean, path: String, data: list of String
# ---------- c_script_2: C# usings ----------
 /* ### Code block from : Junichiro Horikawa, https://github.com/jhorikawa
    ### https://github.com/jhorikawa/GrasshopperProgrammingTutorials/blame/master/0012%20Export%20CSV%20with%20C%23%20for%20Grasshopper/CSVExport.gh
*/
# ---------- c_script_2: C# ----------
   
    if(save){
      var fileinfo = new System.IO.FileInfo(path);
      if(!fileinfo.Directory.Exists){
        fileinfo.Directory.Create();
      }

      var sw = fileinfo.CreateText();
      for(int i = 0; i < data.Count; i++){
        string row = data[i];
        if(i < data.Count - 1){
          sw.WriteLine(row);
        }else{
          sw.Write(row);
        }
      }

      sw.Flush();
      sw.Close();
    }
# ---------- end c_script_2 ----------
value_listener_8 = ValueListener(Elements=create_toggle, SomeProperty=True)  # -> Values, Indices
value_listener_9 = ValueListener(Elements=add_elements.AddedElements, SomeProperty=True)  # -> Values, Indices
value_listener_10 = ValueListener(Elements=create_text_box, NameFilterS="TextBox: Participant", SomeProperty=True)  # -> Values, Indices
value_listener_11 = ValueListener(Elements=behaviour_types, NameFilterS="List Box", SomeProperty=True)  # -> Values, Indices

# ----
# ADD ATTRIBUTES TO NEW POINT
panel_37 = Panel("tether")
dynamic_geometry_pipeline_2 = DynamicGeometryPipeline(
    LayerFilter=panel_37,
    TypeFilter="Point",
    GroupByLayer=False,
    GroupByType=False,
    IncludeHidden=True,
    IncludeLocked=True,
    enableFullPath=False,
    listenToAttributes=True)
merge_4 = Merge(Data1=value_listener_10.Values, Data2=value_listener_11.Values, Data3=list_item)  # -> flatten(Result)
panel_38 = Panel(merge_4)
point = Point(dynamic_geometry_pipeline_2)
panel_39 = Panel("""participant
behaviour_type
timestamp""")
createattributes = CreateAttributes(
    Name=value_listener_10.Values,
    LayerName=panel_37,
    UserDataKeys=flatten(panel_39),
    UserDataValues=merge_4,
    enableFullPath=False)
modify_object_attributes = ModifyObjectAttributes(Objects=point, Attributes=createattributes)

# ----
# VISUALISE POLYLINE
# 1. retrieve object (point) attributes
# 
# attribute 0 is the timestamp
# attribute 1 is the point
geometry_pipeline = GeometryPipeline(
    GroupByLayer=False,
    GroupByType=False,
    IncludeHidden=True,
    IncludeLocked=True,
    LayerFilter="tether",
    NameFilter="*",
    SublayerFiltering=True,
    TypeFilter=1)
point_2 = Point(graft(geometry_pipeline))
object_attributes_2 = ObjectAttributes(ObjectOrAttributes=point_2)  # -> Name, LayerName, LayerFullPath, Color, MaterialName, LinetypeName, GroupIndices, PlotWeight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
list_item_5 = ListItem(List=object_attributes_2.UserDataValues, Index=1, Wrap=True)
list_item_6 = ListItem(List=object_attributes_2.UserDataValues, Index=0, Wrap=True)
list_item_7 = ListItem(List=object_attributes_2.UserDataValues, Index=2, Wrap=True)
match_text = MatchText(Text=list_item_5, Pattern="trajectory", Case=True)
cull_pattern_2 = CullPattern(List=list_item_7, CullPattern=match_text)
cull_pattern_3 = CullPattern(List=point_2, CullPattern=match_text)
list_length = ListLength(List=cull_pattern_3)
sort_list = SortList(Keys=flatten(cull_pattern_2), ValuesValuesA=flatten(cull_pattern_3))  # -> Keys, ValuesValuesA
expression = Expression(x=flatten(list_item_6), y=flatten(list_item_5), z=flatten(list_item_7), Expression="\"P\"& x & \", \" & y & \" \" & z")
unit_x = UnitX(Factor=1)
polyline = PolyLine(Vertices=sort_list.ValuesValuesA, Closed=False)
move = Move(Geometry=flatten(point_2), Motion=unit_x)  # -> Geometry, Transform
expression_2 = Expression(
    x=flatten(list_item_5),
    y=flatten(ColourSwatch(SwatchColor=RGB(206, 0, 73))),
    z=flatten(ColourSwatch(SwatchColor=RGB(56, 199, 0))),
    Expression="if(x = \"trajectory\", y, z)")
panel_40 = Panel(expression)
stream_gate = StreamGate(Stream=expression, Gate=value_listener_8.Values)  # -> Target0, Target1
length = Length(Curve=polyline)
custom_preview_lineweights = CustomPreviewLineweights(
    Geometry=polyline,
    Shader={diffuse=RGB(255, 105, 180), emission=RGB(76, 32, 54), shine=0.5, specular=RGB(255, 255, 255), transparency=0},
    Thickness=Slider(2, range=0..10),
    Absolute=False)
text_tag = TextTag(Location=move.Geometry, Text=stream_gate.Target1, Colour=expression_2)
round_c_2 = CSharpScript(data=length, decimals="2")  # -> out, a; inputs data: Double, decimals: Int32; same code as round_c
list_item_8 = ListItem(List=udp_receiver.Data, Index="2", Wrap=True)  # -> flatten(Item)
data_dam_2 = DataDam(DataDataA=list_item_8, BufferDelay=10000000, BufferMode=2)
concatenate_5 = Concatenate(FragmentA="Length: ", FragmentB=round_c_2.a)
concatenate_6 = Concatenate(FragmentA="Point count: ", FragmentB=list_length)
panel_41 = Panel("""0
100""")
set_label_contents_3 = SetLabelContents(LabelToModify=create_label_2, NewLabelContents=concatenate_6)
set_label_contents_4 = SetLabelContents(LabelToModify=create_label, NewLabelContents=concatenate_5)
set_slider = SetSlider(UISlider=my_slidererb, Value=data_dam_2, Range=panel_41)

# ==== cluster CreateCSV
header = ClusterInput()
data = ClusterInput()
sep = ClusterInput()
merge = Merge(Data1=graft(header), Data2=data)
flip_matrix = FlipMatrix(Data=merge)
text_join = TextJoin(Text=flip_matrix, Join=sep)
flatten_tree = FlattenTree(Tree=text_join, Path="{0}")
panel = Panel(flatten_tree)
tree = ClusterOutput(flatten_tree)
