# Grasshopper definition live drawing 2019.gh (Grasshopper 1.0.7)
# plug-ins: Heteroptera, Human UI, Pufferfish, Human, gHowl

udp_receiver = UDPReceiver(Address="127.0.0.1", Port="12000", Pattern="999")  # -> Info, Data
list_item = ListItem(List=udp_receiver.Data, Index="1", Wrap=True)  # -> flatten(Item)
panel = Panel(list_item)

timer = Timer(TimerInterval=500, Target=[dynamic_geometry_pipeline, dynamic_geometry_pipeline_2])
my_slidererb = CreateSlider(
    Slider=Slider(3, range=0..100),
    SnapValue=1,
    ShowBounds=True,
    ShowTicks=True,
    ShowTooltip=True,
    ShowValLabel=True,
    showLabel=True)
create_button = CreateButton(ButtonName="- 5", ButtonStyle=1)
create_button_2 = CreateButton(ButtonName="+ 5", ButtonStyle=1)

panel_2 = Panel("""trajectory
pause
slow_crowd
looking_around""")
behaviour_types = CreateListBox(ListItems=panel_2, SelectedIndex=0, Height=100)
create_text_box = CreateTextBox(Label="Participant", DefaultText="id", UpdateButton=True, showLabel=True)
create_label = CreateLabel(LabelText="Set Behaviour Type", LabelSize=18, Justification=0)
create_label_2 = CreateLabel(LabelText="0", LabelSize=12, Justification=0)
create_label_3 = CreateLabel(LabelText="Trajectory (Count)", LabelSize=18, Justification=0)
create_label_4 = CreateLabel(LabelText="Trajectory (Length)", LabelSize=18, Justification=0)
create_label_5 = CreateLabel(LabelText="0", LabelSize=12, Justification=0)
merge = Merge(
    Data1=create_text_box,
    Data2=create_label,
    Data3=behaviour_types,
    Data4=create_label_3,
    Data5=create_label_2,
    Data6=create_label_4,
    Data7=create_label_5,
    Data8=my_slidererb,
    Data9=create_button,
    Data10=create_button_2)
launch_window = LaunchWindow(Show=Toggle(True), Name="Timestamp Trajectories", Width=370, Height=400, ChildStatus=2, EnableHorizScroll=False)
add_elements = AddElements(Window=launch_window, Elements=flatten(merge), DoVLChecking=True)  # -> AddedElements, ElementNames
item_selector = ItemSelector(
    add_elements.ElementNames,
    {"TextBox: Participant", "Label: Set Behaviour Type", "List Box", "Label: Trajectory (Count)", "Label: 0", "Label: Trajectory (Length)", "Label: 0 1", "Number Slider", "- 5", "+ 5"}, selected="TextBox: Participant")
value_listener = ValueListener(Elements=add_elements.AddedElements, NameFilterS=item_selector, SomeProperty=True)  # -> Values, Indices
value_listener_2 = ValueListener(Elements=add_elements.AddedElements, NameFilterS="List Box", SomeProperty=True)  # -> Values, Indices
window_status = WindowStatus(Window=launch_window)
panel_3 = Panel(value_listener_2.Values)

value_listener_3 = ValueListener(Elements=add_elements.AddedElements, NameFilterS="- 5", SomeProperty=True)  # -> Values, Indices
value_listener_4 = ValueListener(Elements=add_elements.AddedElements, NameFilterS="Number Slider", SomeProperty=True)  # -> Values, Indices
value_listener_5 = ValueListener(Elements=add_elements.AddedElements, NameFilterS="+ 5", SomeProperty=True)  # -> Values, Indices
panel_4 = Panel(udp_receiver.Data)
panel_5 = Panel(value_listener_3.Values)

dynamic_geometry_pipeline = DynamicGeometryPipeline(
    LayerFilter="Layer 03",
    TypeFilter="Point",
    GroupByLayer=False,
    GroupByType=False,
    IncludeHidden=True,
    IncludeLocked=True,
    enableFullPath=False,
    listenToAttributes=True)
merge_2 = Merge(Data1=list_item, Data2=value_listener_2.Values)  # -> flatten(Result)
point = Point(dynamic_geometry_pipeline)
panel_6 = Panel("""frame
behaviour""")
createattributes = CreateAttributes(
    Name=value_listener.Values,
    LayerName="Layer 03",
    UserDataKeys=flatten(panel_6),
    UserDataValues=merge_2,
    enableFullPath=False)
modify_object_attributes = ModifyObjectAttributes(Objects=point, Attributes=createattributes)

# ---- group: Draws existing points
panel_7 = Panel(value_listener.Values)
dynamic_geometry_pipeline_2 = DynamicGeometryPipeline(
    LayerFilter="Layer 03",
    TypeFilter="Point",
    NameFilter=panel_7,
    GroupByLayer=False,
    GroupByType=False,
    IncludeHidden=True,
    IncludeLocked=True,
    enableFullPath=False,
    listenToAttributes=True)
point_2 = Point(dynamic_geometry_pipeline_2)
unit_x = UnitX(Factor=1)
object_attributes = ObjectAttributes(ObjectOrAttributes=point_2)  # -> Name, LayerName, LayerFullPath, Color, MaterialName, LinetypeName, GroupIndices, PlotWeight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
list_item_2 = ListItem(List=object_attributes.UserDataValues, Index=1, Wrap=True)
list_item_3 = ListItem(List=object_attributes.UserDataValues, Index=0, Wrap=True)
sort_list = SortList(Keys=flatten(list_item_3), ValuesValuesA=point_2)  # -> Keys, ValuesValuesA
move = Move(Geometry=sort_list.ValuesValuesA, Motion=unit_x)  # -> Geometry, Transform
match_text = MatchText(Text=list_item_2, Pattern="trajectory", Case=True)
panel_8 = Panel(object_attributes.UserDataValues)
expression = Expression(x=flatten(object_attributes.Name), y=flatten(sort_list.Keys), Expression="\"P\"& x & \" T\" & y")
cull_pattern = CullPattern(List=point_2, CullPattern=flatten(match_text))
panel_9 = Panel(expression)
polyline = PolyLine(Vertices=cull_pattern, Closed=False)
text_tag = TextTag(Location=move.Geometry, Text=expression, Colour=ColourSwatch(SwatchColor=RGB(255, 255, 255)))
list_length = ListLength(List=cull_pattern)
length = Length(Curve=polyline)
round_to_decimal_place = RoundToDecimalPlace(NumberX=length, DecimalPlace=1, RoundType=0)  # -> Rounded, Difference

# ----
number = Number(value_listener_4.Values)
number_2 = Number(value_listener_3.Values)
number_3 = Number(value_listener_5.Values)
multiplication = Multiplication(A=number_2, B=-5)
multiplication_2 = Multiplication(A=number_3, B=5)
panel_10 = Panel("/GH/none/")
panel_11 = Panel(["/control/slider", number])
panel_12 = Panel(["/control/time", multiplication_2])
panel_13 = Panel(["/control/time", multiplication])
gate_not = GateNot(A=Button())
stream_freeze_gate = StreamFreezeGate(Data=panel_12, PassingSwitch=number_3)
stream_freeze_gate_2 = StreamFreezeGate(Data=panel_13, PassingSwitch=number_2)
udp_sender = UDPSender(Address="127.0.0.1", Port="32000", Pattern="999", Data=stream_freeze_gate)
udp_sender_2 = UDPSender(Address="127.0.0.1", Port="32000", Pattern="999", Data=panel_11)
udp_sender_3 = UDPSender(Address="127.0.0.1", Port="32000", Pattern="999", Data=stream_freeze_gate_2)
list_item_4 = ListItem(List=udp_receiver.Data, Index="2", Wrap=True)  # -> flatten(Item)
custom_preview_lineweights = CustomPreviewLineweights(
    Geometry=polyline,
    Shader={diffuse=RGB(255, 105, 180), emission=RGB(76, 32, 54), shine=0.5, specular=RGB(255, 255, 255), transparency=0},
    Thickness=Slider(5, range=0..10),
    Absolute=False)
panel_14 = Panel("""0
100""")

# ---- group: Update interface
set_label_contents = SetLabelContents(LabelToModify=create_label_2, NewLabelContents=list_length)
set_label_contents_2 = SetLabelContents(LabelToModify=create_label_5, NewLabelContents=round_to_decimal_place.Rounded)
set_slider = SetSlider(UISlider=my_slidererb, Value=list_item_4, Range=panel_14)
